# Grasshopper definition attractor.gh (Grasshopper 1.0.7)

pop2d = Populate2D(Region={Plane=PlaneXY(0, 0, 0), Size=Domain2(u=0..20, v=0..10)}, Count=100, Seed=1)
radgrid = Radial(Plane=PlaneXY(0, 0, 0), Size=1, ExtentR=5, ExtentP=20)  # -> Cells, Points
voronoi = Voronoi(Points=pop2d, BruteForceOverride=False)
hexgrid = Hexagonal(Plane=PlaneXY(0, 0, 0), Size=1, ExtentX=Slider(10, range=1..100), ExtentY=Slider(10, range=1..100))  # -> Cells, Points
crv = Curve(flatten(radgrid.Cells))
area = Area(Geometry=crv)  # -> Area, Centroid
pt = Point(<point referenced from the Rhino model>)
dist = Distance(PointA=area.Centroid, PointB=pt)
bnd = Bounds(Numbers=dist)
dom = ConstructDomain(DomainStart=Slider(0.01, range=0..1), DomainEnd=Slider(1, range=0..1))
remap = RemapNumbers(Value=dist, Source=bnd, Target=dom)  # -> Mapped, Clipped
scale = Scale(Geometry=crv, Center=area.Centroid, Factor=remap.Mapped)  # -> Geometry, Transform
panel = Panel(bnd)
